# Grasshopper definition Test_RCP_HumanUI.gh (Grasshopper 1.0.8)
# Copyright: Co-de-iT
# plug-ins: Human UI, Human

radius = Slider(10.332, range=1..100)
u_count = Slider(10, range=10..100)
v_count = Slider(10, range=10..100)
true_button = CreateTrueOnlyButton(ButtonName="Exit?", ButtonStyle=0)
values = ValueListener(Elements=true_button, SomeProperty=True)  # -> Values, Indices
slider = CreateSlider(Slider=radius, ShowBounds=False, ShowTicks=False, ShowTooltip=False, ShowValLabel=True, showLabel=True)
slider_2 = CreateSlider(Slider=u_count, ShowBounds=False, ShowTicks=False, ShowTooltip=False, ShowValLabel=True, showLabel=True)
slider_3 = CreateSlider(Slider=v_count, ShowBounds=False, ShowTicks=False, ShowTooltip=False, ShowValLabel=True, showLabel=True)
gate = StreamGate(Stream="End program", Gate=values.Values)  # -> Target0, Target1
not = GateNot(A=values.Values)
merge = Merge(Data1=slider, Data2=slider_2, Data3=slider_3)
context_print = ContextPrint(Text=gate.Target1)
values_2 = ValueListener(Elements=slider, SomeProperty=True)  # -> Values, Indices
values_3 = ValueListener(Elements=slider_2, SomeProperty=True)  # -> Values, Indices
values_4 = ValueListener(Elements=slider_3, SomeProperty=True)  # -> Values, Indices
setslider = SetSlider(UISlider=merge)
msphere = MeshSphere(Base=PlaneXY(0, 0, 0), Radius=values_2.Values, UCount=values_3.Values, VCount=values_4.Values)
merge_2 = Merge(Data1=merge, Data2=true_button)
launchwin = LaunchWindow(Show=not, Name="Test", Width=370, Height="250", ChildStatus=0, EnableHorizScroll=False)
gate_2 = StreamGate(Stream=msphere, Gate=values.Values)  # -> Target0, Target1
addelems = AddElements(Window=launchwin, Elements=flatten(merge_2), DoVLChecking=True)  # -> AddedElements, ElementNames

# ---- group: display Mesh geometry with edges
mesh = Mesh(gate_2.Target0)
medges = MeshEdges(Mesh=mesh)  # -> NakedEdges, InteriorEdges, NonManifoldEdges
preview = CustomPreview(Geometry=mesh, Material=ColourSwatch(SwatchColor=RGB(0, 255, 255)))
previewlw = CustomPreviewLineweights(Geometry=[medges.NakedEdges, medges.InteriorEdges], Shader=ColourSwatch(SwatchColor=RGB(0, 0, 0)), Absolute=False)
