# Grasshopper definition Test_RCP_Synapse.gh (Grasshopper 1.0.8)
# Copyright: Co-de-iT
# plug-ins: RhinoCodePluginGH, Synapse, eleFront

# ----
# Exit button
panel = Panel("9")
# Bake button
panel_2 = Panel("BAKE")
int = Integer(panel)
to_eto_color = CSharpScript(C=ColourSwatch(SwatchColor=RGB(0, 0, 0)))  # -> cH; inputs C: Color
# ---------- to_eto_color: C# ----------
// Grasshopper Script Instance
#region Usings
using System;
using System.Linq;
using System.Collections;
using System.Collections.Generic;
using System.Drawing;

using Rhino;
using Rhino.Geometry;

using Grasshopper;
using Grasshopper.Kernel;
using Grasshopper.Kernel.Data;
using Grasshopper.Kernel.Types;

#endregion

public class Script_Instance : GH_ScriptInstance
{
    #region Notes
    /* 
      Members:
        RhinoDoc RhinoDocument
        GH_Document GrasshopperDocument
        IGH_Component Component
        int Iteration

      Methods (Virtual & overridable):
        Print(string text)
        Print(string format, params object[] args)
        Reflect(object obj)
        Reflect(object obj, string method_name)
    */
    #endregion

    private void RunScript(Color C, ref object cH)
    {
        // Write your logic here
        cH = C.ToEto();
    }
}
# ---------- end to_eto_color ----------
to_eto_color_2 = CSharpScript(C=ColourSwatch(SwatchColor=RGB(194, 186, 147)))  # -> cH; inputs C: Color; same code as to_eto_color
ssize = SnpSize(Width=Slider(10, range=10..100), Height=Slider(40, range=10..100))
sfont = SnpFont(FontFamily="Arial", FontSize=int, FontStyle="1", Decoration=0)
panel_3 = Panel("""Text
Size
BackgroundColor
TextColor
Font""")
merge = Merge(
    Data1=flatten(panel_2),
    Data2=flatten(ssize),
    Data3=flatten(to_eto_color_2),
    Data4=flatten(to_eto_color),
    Data5=flatten(sfont))
sbtn = SynapseButton(Property=flatten(panel_3), PropertyValue=flatten(merge))  # -> AllProperties, Control

# ---- group: check OS Platform
c_script = CSharpScript()  # -> OS
# ---------- c_script: C# ----------
// Grasshopper Script Instance
#region Usings
using System;
using System.Linq;
using System.Collections;
using System.Collections.Generic;
using System.Drawing;

using Rhino;
using Rhino.Geometry;

using Grasshopper;
using Grasshopper.Kernel;
using Grasshopper.Kernel.Data;
using Grasshopper.Kernel.Types;
#endregion

public class Script_Instance : GH_ScriptInstance
{
    #region Notes
    /* 
      Members:
        RhinoDoc RhinoDocument
        GH_Document GrasshopperDocument
        IGH_Component Component
        int Iteration

      Methods (Virtual & overridable):
        Print(string text)
        Print(string format, params object[] args)
        Reflect(object obj)
        Reflect(object obj, string method_name)
    */
    #endregion

    private void RunScript(ref object OS)
    {
        // Write your logic here
        OS = Environment.OSVersion.Platform;
    }
}
# ---------- end c_script ----------
tmatch = MatchText(Text=c_script, Pattern="Win*", Case=True)

# ----
svalq = SnpValueQuery(SynapseObject=sbtn.Control)
value_proofing = CSharpScript(V=svalq, dV="False")  # -> Vd
# ---------- value_proofing: C# ----------
// Grasshopper Script Instance
#region Usings
using System;
using System.Linq;
using System.Collections;
using System.Collections.Generic;
using System.Drawing;

using Rhino;
using Rhino.Geometry;

using Grasshopper;
using Grasshopper.Kernel;
using Grasshopper.Kernel.Data;
using Grasshopper.Kernel.Types;
#endregion

public class Script_Instance : GH_ScriptInstance
{
    #region Notes
    /* 
      Members:
        RhinoDoc RhinoDocument
        GH_Document GrasshopperDocument
        IGH_Component Component
        int Iteration

      Methods (Virtual & overridable):
        Print(string text)
        Print(string format, params object[] args)
        Reflect(object obj)
        Reflect(object obj, string method_name)
    */
    #endregion

    private void RunScript(object V, object dV, ref object Vd)
    {
        // Write your logic here
        Vd = V == null? dV:V;
    }
}
# ---------- end value_proofing ----------

# ----
# Geometry and preview
get_boolean = GetBoolean(AtLeast=1, AtMost=1, FalseValue="False", TreeAccess=False, TrueValue="True")
panel_4 = Panel("""Radius
UCount
VCount""")

int_2 = Integer("250")
int_3 = Integer("1")
int_4 = Integer("10")
snaptotick = BooleanToggle(True)
slider_properties = Panel("""Width
MinValue
MaxValue
Value
SnapToTick
TickFrequency""")

height = Slider(40, range=10..100)
int_5 = Integer(panel)
to_eto_color_3 = CSharpScript(C=ColourSwatch(SwatchColor=RGB(255, 255, 255)))  # -> cH; inputs C: Color; same code as to_eto_color
to_eto_color_4 = CSharpScript(C=ColourSwatch(SwatchColor=RGB(176, 29, 0)))  # -> cH; inputs C: Color; same code as to_eto_color
sfont_2 = SnpFont(FontFamily="Arial", FontSize=int_5, FontStyle="1", Decoration=0)
int_6 = Integer(height)
panel_5 = Panel("""Height
Text
BackgroundColor
TextColor
Font""")
merge_2 = Merge(
    Data1=flatten(int_6),
    Data2=flatten("Exit"),
    Data3=flatten(to_eto_color_4),
    Data4=flatten(to_eto_color_3),
    Data5=flatten(sfont_2))
sbtn_2 = SynapseButton(Property=flatten(panel_5), PropertyValue=flatten(merge_2))  # -> AllProperties, Control

int_7 = Integer("10")
to_eto_color_5 = CSharpScript(C=ColourSwatch(SwatchColor=RGB(0, 0, 0)))  # -> cH; inputs C: Color; same code as to_eto_color
list = ValueList({"Left": 0, "Center": 1, "Right": 2}, selected="Right")
panel_6 = Panel("""Text
TextAlignment
TextColor""")
merge_3 = Merge(Data1=flatten("V Count"), Data2=flatten(list), Data3=flatten(to_eto_color_5))
slabel = SnpTextLabel(Property=flatten(panel_6), PropertyValue=flatten(merge_3))  # -> AllProperties, Control

int_8 = Integer("100")
merge_4 = Merge(
    Data1=flatten(int_2),
    Data2=flatten(int_4),
    Data3=flatten(int_8),
    Data4=flatten(int_7),
    Data5=flatten(snaptotick),
    Data6=flatten(int_3))
sintsl = SnpIntSlider(Property=flatten(slider_properties), PropertyValue=flatten(merge_4))  # -> AllProperties, Control

list_2 = ValueList({"Left": 0, "Center": 1, "Right": 2}, selected="Left")
panel_7 = Panel("""Text
TextAlignment
TextColor""")
merge_5 = Merge(Data1=flatten(int_7), Data2=flatten(list_2), Data3=flatten(to_eto_color_5))
slabel_2 = SnpTextLabel(Property=flatten(panel_7), PropertyValue=flatten(merge_5))  # -> AllProperties, Control

# ---- group: value proofing
svalq_2 = SnpValueQuery(SynapseObject=sintsl.Control)
value_proofing_2 = CSharpScript(V=svalq_2, dV=int_7)  # -> Vd
# ---------- value_proofing_2: C# ----------
// Grasshopper Script Instance
#region Usings
using System;
using System.Linq;
using System.Collections;
using System.Collections.Generic;
using System.Drawing;

using Rhino;
using Rhino.Geometry;

using Grasshopper;
using Grasshopper.Kernel;
using Grasshopper.Kernel.Data;
using Grasshopper.Kernel.Types;
#endregion

public class Script_Instance : GH_ScriptInstance
{
    #region Notes
    /* 
      Members:
        RhinoDoc RhinoDocument
        GH_Document GrasshopperDocument
        IGH_Component Component
        int Iteration

      Methods (Virtual & overridable):
        Print(string text)
        Print(string format, params object[] args)
        Reflect(object obj)
        Reflect(object obj, string method_name)
    */
    #endregion

    private void RunScript(object V, object dV, ref object Vd)
    {
        // Write your logic here

        Vd = V == null? dV:V;
    }
}
# ---------- end value_proofing_2 ----------

# ----
merge_6 = Merge(Data1=flatten(slabel.Control), Data2=flatten(sintsl.Control), Data3=flatten(slabel_2.Control))
stxy = SnpTableXY(Controls=merge_6, Rows="1")  # -> Coordinates, Dimensions
stable = SnpTableLayout(Controls=flatten(merge_6), ControlLocation=flatten(stxy.Coordinates), TableDimension=stxy.Dimensions)  # -> AllProperties, Control

multiplication = Multiplication(A=value_proofing_2, B="0.01")
expression = Expression(x=multiplication, Expression="Format(\"{0:0.00}\", x)")

# ---- group: SRM label update
txt = Text(value_proofing_2)
synapse_value_update = CSharpScript(C=slabel_2.Control, P="Text", V=txt)  # inputs P: String
# ---------- synapse_value_update: C# ----------
// Grasshopper Script Instance
#region Usings
using System;
using System.Linq;
using System.Collections;
using System.Collections.Generic;
using System.Drawing;

using Rhino;
using Rhino.Geometry;

using Grasshopper;
using Grasshopper.Kernel;
using Grasshopper.Kernel.Data;
using Grasshopper.Kernel.Types;

using Eto;

#endregion

public class Script_Instance : GH_ScriptInstance
{
    #region Notes
    /* 
      Members:
        RhinoDoc RhinoDocument
        GH_Document GrasshopperDocument
        IGH_Component Component
        int Iteration

      Methods (Virtual & overridable):
        Print(string text)
        Print(string format, params object[] args)
        Reflect(object obj)
        Reflect(object obj, string method_name)
    */
    #endregion

    private void RunScript(object C, string P, object V)
    {
        // Write your logic here

        if (C == null || P == null || V == null) return;

        var prop = C.GetType().GetProperty(P);
        try
        {
            prop.SetValue(C,V);
        }
        catch
        {
            Component.AddRuntimeMessage(GH_RuntimeMessageLevel.Error, "Can't set value for property" + P);
        }
    }
}
# ---------- end synapse_value_update ----------

# ----
int_9 = Integer("250")
int_10 = Integer("100")
int_11 = Integer("10")
snaptotick_2 = BooleanToggle(True)
slider_properties_2 = Panel("""Width
MinValue
MaxValue
Value
SnapToTick
TickFrequency""")

int_12 = Integer("250")
int_13 = Integer("10")
int_14 = Integer("1")
snaptotick_3 = BooleanToggle(True)
slider_properties_3 = Panel("""Width
MinValue
MaxValue
Value
SnapToTick
TickFrequency""")

int_15 = Integer("1000")
to_eto_color_6 = CSharpScript(C=ColourSwatch(SwatchColor=RGB(0, 0, 0)))  # -> cH; inputs C: Color; same code as to_eto_color
list_3 = ValueList({"Left": 0, "Center": 1, "Right": 2}, selected="Right")
panel_8 = Panel("""Text
TextAlignment
TextColor""")
merge_7 = Merge(Data1=flatten("Radius"), Data2=flatten(list_3), Data3=flatten(to_eto_color_6))
slabel_3 = SnpTextLabel(Property=flatten(panel_8), PropertyValue=flatten(merge_7))  # -> AllProperties, Control

int_16 = Integer("10000")
merge_8 = Merge(
    Data1=flatten(int_9),
    Data2=flatten(int_10),
    Data3=flatten(int_16),
    Data4=flatten(int_15),
    Data5=flatten(snaptotick_2),
    Data6=flatten(int_11))
sintsl_2 = SnpIntSlider(Property=flatten(slider_properties_2), PropertyValue=flatten(merge_8))  # -> AllProperties, Control

list_4 = ValueList({"Left": 0, "Center": 1, "Right": 2}, selected="Left")
panel_9 = Panel("""Text
TextAlignment
TextColor""")
merge_9 = Merge(Data1=flatten(int_15), Data2=flatten(list_4), Data3=flatten(to_eto_color_6))
slabel_4 = SnpTextLabel(Property=flatten(panel_9), PropertyValue=flatten(merge_9))  # -> AllProperties, Control

# ---- group: value proofing
svalq_3 = SnpValueQuery(SynapseObject=sintsl_2.Control)
value_proofing_3 = CSharpScript(V=svalq_3, dV=int_15)  # -> Vd; same code as value_proofing_2

# ----
merge_10 = Merge(Data1=flatten(slabel_3.Control), Data2=flatten(sintsl_2.Control), Data3=flatten(slabel_4.Control))
stxy_2 = SnpTableXY(Controls=merge_10, Rows="1")  # -> Coordinates, Dimensions
stable_2 = SnpTableLayout(Controls=flatten(merge_10), ControlLocation=flatten(stxy_2.Coordinates), TableDimension=stxy_2.Dimensions)  # -> AllProperties, Control

multiplication_2 = Multiplication(A=value_proofing_3, B="0.01")
expression_2 = Expression(x=multiplication_2, Expression="Format(\"{0:0.00}\", x)")

# ---- group: SRM label update
txt_2 = Text(expression_2)
synapse_value_update_2 = CSharpScript(C=slabel_4.Control, P="Text", V=txt_2)  # inputs P: String; same code as synapse_value_update

# ----
int_17 = Integer("10")
to_eto_color_7 = CSharpScript(C=ColourSwatch(SwatchColor=RGB(0, 0, 0)))  # -> cH; inputs C: Color; same code as to_eto_color
list_5 = ValueList({"Left": 0, "Center": 1, "Right": 2}, selected="Right")
panel_10 = Panel("""Text
TextAlignment
TextColor""")
merge_11 = Merge(Data1=flatten("U Count"), Data2=flatten(list_5), Data3=flatten(to_eto_color_7))
slabel_5 = SnpTextLabel(Property=flatten(panel_10), PropertyValue=flatten(merge_11))  # -> AllProperties, Control

int_18 = Integer("100")
merge_12 = Merge(
    Data1=flatten(int_12),
    Data2=flatten(int_13),
    Data3=flatten(int_18),
    Data4=flatten(int_17),
    Data5=flatten(snaptotick_3),
    Data6=flatten(int_14))
sintsl_3 = SnpIntSlider(Property=flatten(slider_properties_3), PropertyValue=flatten(merge_12))  # -> AllProperties, Control

list_6 = ValueList({"Left": 0, "Center": 1, "Right": 2}, selected="Left")
panel_11 = Panel("""Text
TextAlignment
TextColor""")
merge_13 = Merge(Data1=flatten(int_17), Data2=flatten(list_6), Data3=flatten(to_eto_color_7))
slabel_6 = SnpTextLabel(Property=flatten(panel_11), PropertyValue=flatten(merge_13))  # -> AllProperties, Control

# ---- group: value proofing
svalq_4 = SnpValueQuery(SynapseObject=sintsl_3.Control)
value_proofing_4 = CSharpScript(V=svalq_4, dV=int_17)  # -> Vd; same code as value_proofing_2

# ----
merge_14 = Merge(Data1=flatten(slabel_5.Control), Data2=flatten(sintsl_3.Control), Data3=flatten(slabel_6.Control))
stxy_3 = SnpTableXY(Controls=merge_14, Rows="1")  # -> Coordinates, Dimensions
stable_3 = SnpTableLayout(Controls=flatten(merge_14), ControlLocation=flatten(stxy_3.Coordinates), TableDimension=stxy_3.Dimensions)  # -> AllProperties, Control

multiplication_3 = Multiplication(A=value_proofing_4, B="0.01")
expression_3 = Expression(x=multiplication_3, Expression="Format(\"{0:0.00}\", x)")

# ---- group: SRM label update
txt_3 = Text(value_proofing_4)
synapse_value_update_3 = CSharpScript(C=slabel_6.Control, P="Text", V=txt_3)  # inputs P: String; same code as synapse_value_update

# ----
merge_15 = Merge(Data2=stable_2.Control, Data3=stable_3.Control, Data4=stable.Control, Data5=sbtn.Control, Data6=sbtn_2.Control)
merge_16 = Merge(Data1=multiplication_2, Data2=value_proofing_4, Data3=value_proofing_2)

# ---- group: value proofing
svalq_5 = SnpValueQuery(SynapseObject=sbtn_2.Control)

# ---- group: value proofing / manage exit on Mac
# - on start: False
# - on exit: True
# - restart (on recompute): False
c_script_2 = CSharpScript(V=svalq_5)  # -> Vn, e
# ---------- c_script_2: C# ----------
// Grasshopper Script Instance
#region Usings
using System;
using System.Linq;
using System.Collections;
using System.Collections.Generic;
using System.Drawing;

using Rhino;
using Rhino.Geometry;

using Grasshopper;
using Grasshopper.Kernel;
using Grasshopper.Kernel.Data;
using Grasshopper.Kernel.Types;
#endregion

public class Script_Instance : GH_ScriptInstance
{
    #region Notes
    /* 
      Members:
        RhinoDoc RhinoDocument
        GH_Document GrasshopperDocument
        IGH_Component Component
        int Iteration

      Methods (Virtual & overridable):
        Print(string text)
        Print(string format, params object[] args)
        Reflect(object obj)
        Reflect(object obj, string method_name)
    */
    #endregion

    private void RunScript(object V, ref object Vn, ref object e)
    {
        // Write your logic here
        value = V==null?false:(bool)V;
        if(value) exit = true;
        if(V==null && exit) exit = false;
        //Component.SolutionExpired += (e, args) =>{value = true;};
        Vn = value || exit;
        e = exit;
    }

    bool value = false;
    bool exit = false;
}
# ---------- end c_script_2 ----------

# ----
filter = StreamFilter(Gate=tmatch, Stream0=c_script_2.Vn, Stream1=svalq_5)
panel_12 = Panel([c_script_2.Vn, c_script_2.e])

# ---- group: value proofing (continued)
value_proofing_5 = CSharpScript(V=filter, dV="False")  # -> Vd; same code as value_proofing
panel_13 = Panel(value_proofing_5)

# ----
bool = Boolean(value_proofing_5)

msphere = MeshSphere(Base=PlaneXY(0, 0, 0), Radius=multiplication_2, UCount=value_proofing_4, VCount=value_proofing_2)
gate = StreamGate(Stream=msphere, Gate=value_proofing_5)  # -> Target0, Target1

gate_2 = StreamGate(Stream="End program", Gate=bool)  # -> Target0, Target1
context_print = ContextPrint(Text=gate_2.Target1)

not = GateNot(A=bool)
and = GateAnd(A="True", B=not)

# ---- group: display Mesh geometry with edges
mesh = Mesh(gate.Target0)
medges = MeshEdges(Mesh=mesh)  # -> NakedEdges, InteriorEdges, NonManifoldEdges
preview = CustomPreview(Geometry=mesh, Material=ColourSwatch(SwatchColor=RGB(255, 255, 255)))

# ----
swindow = SynapseWindow(Show=and, Contents=flatten(merge_15), ctrlfill=True, ctrlredo=True, ghowned=False)  # -> AllProperties, Window
u_text = UserText(Content=msphere, Keys=panel_4, Values=merge_16, UserTextMode=1)  # -> Content, Keys, Values

layer = ModelLayer(Layer="MyLayer")  # -> Layer, Name, Hidden, Locked, DisplayColour, Material, Linetype
# Content Crate
object = ModelObject(Object=u_text.Content, Layer=layer.Layer)  # -> Object, Geometry, Name, Layer, Visibility, Display, Drafting, Render
cache = ContentCache(Content=object.Object, Action=value_proofing)  # disabled

# ----
# Elefront
ef_att = EleFrontAttributes(Keys=u_text.Keys, Values=u_text.Values, Layer="MyLayer", maintainBakeName=False)  # -> Attributes, Keys, Values, Name, Layer, ColourSource, DisplayColour, MaterialSource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
bake = BakeObjects(Geometry=msphere, Attributes=ef_att.Attributes, Bake=value_proofing, createGroups=False)  # -> Message, Ghosts
