# Grasshopper definition Test_RCP_UIPlus.gh (Grasshopper 1.0.8)
# Copyright: Co-de-iT
# plug-ins: Human, UiPlus

button = UiButton(Label="Exit?")
slider = UiSlider(Label="Radius", Value="10", Bounds="1 to 1000", Increment="0.01")
slider_2 = UiSlider(Label="U Count", Value="10", Bounds="10 to 100", Increment="1")
slider_3 = UiSlider(Label="V Count", Value="10", Bounds="10 to 100", Increment="1")
get_values = UiValues(Element=button)
gate = StreamGate(Stream="End program", Gate=get_values)  # -> Target0, Target1
context_print = ContextPrint(Text=gate.Target1)
merge = Merge(Data1=flatten(slider), Data2=flatten(slider_2), Data3=flatten(slider_3), Data4=flatten(button))
get_values_2 = UiValues(Element=merge)  # -> flatten(Values)
item = ListItem(List=get_values_2, Index=0, Wrap=True)  # -> Item, Item1, Item2
msphere = MeshSphere(Base=PlaneXY(0, 0, 0), Radius=item.Item, UCount=item.Item1, VCount=item.Item2)
window = UiWindow(Elements=merge, Title="Ui+ Viewer", Owner=2, Scroll=False, Launch=Button())
gate_2 = StreamGate(Stream=msphere, Gate=get_values)  # -> Target0, Target1

# ---- group: display Mesh geometry with edges
mesh = Mesh(gate_2.Target0)
medges = MeshEdges(Mesh=mesh)  # -> NakedEdges, InteriorEdges, NonManifoldEdges
preview = CustomPreview(Geometry=mesh, Material=ColourSwatch(SwatchColor=RGB(0, 255, 255)))
previewlw = CustomPreviewLineweights(Geometry=[medges.NakedEdges, medges.InteriorEdges], Shader=ColourSwatch(SwatchColor=RGB(0, 0, 0)), Absolute=False)

# ----
modify_win = UiModifyWindow(Window=window)
